vi "index.gviweb"   [LabVIEW NXG 4.0.0]
panel controls:
  "Id": string
  "Password": string
  "Type of function": string
  "Checkbox": bool
panel indicators:
  "double precision float": f64
  "Chart": f64
  "degree": f64
  "Radians": f64
  "Tab": i32
diagram:
  # Place setup code before the loop. For example, perform initial data communication and wire the results into the loop.
  # Top-Level WebVIs usually contain a While Loop that never stops so that they can continue running as long as the web page is open in the user's web browser.
  s1 = uninitialised  # shift register
  while (iteration -> i1) {
    To Double Precision Float(number=i1) -> w1
    Divide(x=w1, y=6.28) -> w2
    Quotient And Remainder(x=w2, y=6.28) -> (x-y*floor(x/y)=w3)
    Is Equal(x=$Password, y="panchal123") -> w4
    Is Equal(x=$Id, y="Sachindra") -> w5
    Is Equal(x=$Id, y="Mehul") -> w6
    Is Equal(x=$Id, y="Rajesh") -> w7
    Is Equal(x=$Id, y="Nikhil") -> w8
    Is Equal(x=$Id, y="Bhoomi") -> w9
    Is Equal(x=$Id, y="Dinky") -> w10
    Is Equal(x=$Id, y="Piya") -> w11
    Is Equal(x=$Id, y="Pintu") -> w12
    Is Equal(x=$Id, y="Vipul") -> w13
    Is Equal(x=$Id, y="Anurag") -> w14
    Logical Or(w13, w12, w11, w10, w7, w8, w9, w5, w6, w14) -> w15
    Logical And(w15, w4) -> w16
    Logical And(w16, $Checkbox) -> w17
    case (w17) {
      frame False, Default {
        w18 = 0
        w19 = 0
        w20 = 0
        w21 = 0
        w22 = 0
        w23 = 0
        w24 = 0
      }
      frame True {
        Is Equal(x=$"Type of function", y="sin") -> w25
        case (w25) {
          frame False, Default {
            w18 = 0
          }
          frame True {
            Sine(x=w3) -> w18
          }
        }
        Is Equal(x=$"Type of function", y="cos") -> w26
        case (w26) {
          frame False, Default {
            w19 = 0
          }
          frame True {
            Cosine(x=w3) -> w19
          }
        }
        Is Equal(x=$"Type of function", y="sec") -> w27
        case (w27) {
          frame False, Default {
            w21 = 0
          }
          frame True {
            Secant(x=w3) -> w21
          }
        }
        Is Equal(x=$"Type of function", y="cosec") -> w28
        case (w28) {
          frame False, Default {
            w20 = 0
          }
          frame True {
            Cosecant(x=w3) -> w20
          }
        }
        Is Equal(x=$"Type of function", y="sinc") -> w29
        case (w29) {
          frame False, Default {
            w22 = 0
          }
          frame True {
            Sinc(x=w3) -> w22
          }
        }
        Is Equal(x=$"Type of function", y="cot") -> w30
        case (w30) {
          frame False, Default {
            w24 = 0
          }
          frame True {
            Cotangent(x=w3) -> w24
          }
        }
        Is Equal(x=$"Type of function", y="tan") -> w31
        case (w31) {
          frame False, Default {
            w23 = 0
          }
          frame True {
            Tangent(x=w3) -> w23
          }
        }
      }
    }
    Add(w18, w19, w21, w20, w22, w24, w23) -> w32
    In Range And Coerce(lower limit=-5, upper limit=5, x=w32) -> (coerced(x)=w33)
    To Double Precision Float(number=w33) -> w34
    $"double precision float" <- w34
    Select(s=w17, t=1, f=0) -> w35
    To Double Precision Float(number=w35) -> w36
    $Tab <- w36
    $degree <- w3
    $Chart <- w34
    Multiply(w3, 57.324) -> w37
    $Radians <- w37
    Wait(time to wait=50)
    Not(x=FALSE) -> w38
    Is Equal To 0(x=w3) -> w39
    Select(s=w39, t=w38, f=FALSE) -> w40
    next s1 = w40
    stop if FALSE
  }
